# Grasshopper definition 000_using_compas_in_gh.ghx (Grasshopper 1.0.7)

python = GhPythonScript()  # -> a
# ---------- python: Python ----------
import compas
import compas.geometry as cg

# Modeling and Computation
point = cg.Point(19, 25, 7)

# Visualization
if compas.is_grasshopper():
    a = point
else:
    from compas_view2.app import App
    viewer = App()
    viewer.add(point)
    viewer.run()
# ---------- end python ----------
draw = Draw(cg=python)  # -> rg
#   port cg: The COMPAS geometry or datastructure to be drawn.
#   port rg: The Rhino geometry object.
# ---------- draw: Python ----------
"""
Draws COMPAS geometry in Grasshopper.
"""
from ghpythonlib.componentbase import executingcomponent as component

from compas.artists import Artist


class CompasToRhinoGeometry(component):
    def RunScript(self, cg):
        if not cg:
            return None

        return Artist(cg).draw()
# ---------- end draw ----------
